# Grasshopper definition UWGWorkflow.gh (Grasshopper 0.9.76)
# plug-ins: Python Interpreter

parkingtransitbuildings = Brep([<brep referenced from the Rhino model> x6])
# Import Urban
# Geometry
commercialbuildings = Brep([<brep referenced from the Rhino model> x13])
residentialbuildings = Brep([<brep referenced from the Rhino model> x30])
terrain = Brep(<brep referenced from the Rhino model>)
grass = Brep([<brep referenced from the Rhino model> x4])
trees = Brep([<brep referenced from the Rhino model> x178])

ladybug = Ladybug_Ladybug()  # -> Vviiiiiiiiiizzz; plug-in component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
dragonfly = Dragonfly_Dragonfly()  # -> Vviiiiiiiiiizzz; plug-in component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

# ----
# 1
toggle = BooleanToggle(True)

# ----
# Visualize Urban Area
swatch = ColourSwatch(SwatchColor=RGB(82, 82, 82))
preview = CustomPreview(Geometry=terrain, Shader=swatch)
preview_2 = CustomPreview(Geometry=grass, Shader=ColourSwatch(SwatchColor=RGB(118, 168, 133)))
preview_3 = CustomPreview(Geometry=trees, Shader=ColourSwatch(SwatchColor=RGB(40, 102, 58)))
preview_4 = CustomPreview(Geometry=commercialbuildings, Shader=ColourSwatch(SwatchColor=RGB(95, 100, 178)))
preview_5 = CustomPreview(Geometry=residentialbuildings, Shader=ColourSwatch(SwatchColor=RGB(235, 206, 94)))
preview_6 = CustomPreview(Geometry=parkingtransitbuildings, Shader=ColourSwatch(SwatchColor=RGB(143, 143, 143)))

bldgprograms = Dragonfly_bldgPrograms({"FullServiceRestaurant", "Hospital", "LargeHotel", "LargeOffice", "MediumOffice", "MidRiseApartment", "OutPatient", "PrimarySchool", "QuickServiceRestaurant", "SecondarySchool", "SmallHotel", "SmallOffice", "StandAloneRetail", "StripMall", "SuperMarket", "Warehouse"}, selected="MidRiseApartment")
bldgprograms_2 = Dragonfly_bldgPrograms({"FullServiceRestaurant", "Hospital", "LargeHotel", "LargeOffice", "MediumOffice", "MidRiseApartment", "OutPatient", "PrimarySchool", "QuickServiceRestaurant", "SecondarySchool", "SmallHotel", "SmallOffice", "StandAloneRetail", "StripMall", "SuperMarket", "Warehouse"}, selected="Warehouse")
# Define Building Typologies
bldgprograms_3 = Dragonfly_bldgPrograms({"FullServiceRestaurant", "Hospital", "LargeHotel", "LargeOffice", "MediumOffice", "MidRiseApartment", "OutPatient", "PrimarySchool", "QuickServiceRestaurant", "SecondarySchool", "SmallHotel", "SmallOffice", "StandAloneRetail", "StripMall", "SuperMarket", "Warehouse"}, selected="LargeOffice")
bldgage = Dragonfly_bldgPrograms({"Pre-1980's": 0, "1980's-Present": 1, "New Construction": 2}, selected="Pre-1980's")
bldgage_2 = Dragonfly_bldgPrograms({"Pre-1980's": 0, "1980's-Present": 1, "New Construction": 2}, selected="1980's-Present")
bldgage_3 = Dragonfly_bldgPrograms({"Pre-1980's": 0, "1980's-Present": 1, "New Construction": 2}, selected="1980's-Present")
bldgtypology = Dragonfly_UWGBuildingTypology(bldgGeo=parkingtransitbuildings, bldgProgram=bldgprograms_2, bldgAge=bldgage_2, runIt=toggle)  # -> readMe, port, buildingTypology, port_2, bldgFootprints, facadeBreps; plug-in component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
bldgtypology_2 = Dragonfly_UWGBuildingTypology(bldgGeo=residentialbuildings, bldgProgram=bldgprograms, bldgAge=bldgage, runIt=toggle)  # -> readMe, port, buildingTypology, port_2, bldgFootprints, facadeBreps; plug-in component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
bldgtypology_3 = Dragonfly_UWGBuildingTypology(bldgGeo=commercialbuildings, bldgProgram=bldgprograms_3, bldgAge=bldgage_3, runIt=toggle)  # -> readMe, port, buildingTypology, port_2, bldgFootprints, facadeBreps; plug-in component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

vegpar = Dragonfly_VegetationParameters(treeLatentFraction="0.8")  # -> vegetationPar; plug-in component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
pavementpar = Dragonfly_PavementParameters(albedo="0.25")  # -> pavementPar; plug-in component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
trafficpar = Dragonfly_TrafficParameters(sensibleHeat="10")  # -> trafficPar; plug-in component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

panel = Panel([bldgtypology_3.readMe, bldgtypology_2.readMe, bldgtypology.readMe])
exportladybug = Ladybug_ExportLadybug(targetFolder="C:\Users\chris\Documents\GitHub\Dragonfly\newPlugin", export=Toggle(False))  # -> readMe; plug-in component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
# 2
toggle_2 = BooleanToggle(False)
exportladybug_2 = Ladybug_ExportLadybug(components=pavementpar, targetFolder="C:\Users\chris\Documents\GitHub\Dragonfly\newPlugin", export=Toggle(False))  # -> readMe; plug-in component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
# Define the City
uwgcity = Dragonfly_UWGCity(
    buildingTypologies=flatten([bldgtypology_3.buildingTypology, bldgtypology_2.buildingTypology, bldgtypology.buildingTypology]),
    terrainBrep=flatten(terrain),
    treesOrCoverage=flatten(trees),
    grassOrCoverage=flatten(grass),
    trafficPar=trafficpar,
    vegetationPar=vegpar,
    pavementPar=pavementpar,
    runIt=toggle_2)  # -> readMe, port, UWGCity, port_2, treeFootprints, terrainSrf; plug-in component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
panel_2 = Panel(uwgcity.readMe)

# ----
# Import Climate Data
panel_3 = Panel("http://apps1.eere.energy.gov/buildings/energyplus/weatherdata/4_north_and_central_america_wmo_region_4/1_usa/USA_FL_Miami.Intl.AP.722020_TMY3.zip")
epw_stat = Ladybug_OpenEPWAndSTATWeatherFiles(weatherFileURL=panel_3)  # -> epwFile, statFile; plug-in component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

# ----
# 3
toggle_3 = BooleanToggle(False)

boundarylayerpar = Dragonfly_BoundaryLayerParameters()  # -> boundLayerPar; plug-in component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
# Run the UWG
refepwpar = Dragonfly_ReferenceEPWParameters(vegetationCoverage="1")  # -> epwSitePar; plug-in component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
runuwg = Dragonfly_RunUrbanWeatherGenerator(
    epwFile=epw_stat.epwFile,
    UWGCity=uwgcity.UWGCity,
    epwSitePar=refepwpar,
    boundLayerPar=boundarylayerpar,
    writeFile=toggle_3,
    runUWG=toggle_3)  # -> readMe, port, uwgFileAddress, epwFileAddress, port_2, uwgText; plug-in component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
